# Grasshopper definition 00_VPLine_B.gh (Grasshopper 1.0.8)
# plug-ins: Pufferfish, Rhino.Inside for Autodesk Revit

doubleclick = BooleanToggle(False)
dss_annotation_panel = Panel("Help on WhiteWork")
# Segment
# group modules into larger coherent parts
# User Interface: I/O
dss_log_v5_2 = PythonScript(Help=doubleclick)  # inputs Help: Boolean
# ---------- dss_log_v5_2: Python ----------
"""
Set grasshopper template and provide easy acces to Help file in intranet

"""

"""
Credits:
    20211117
    Created by Vladimir Ondejcik
    White arkitekter AB

Based on:
    WOMBAT version <0.0.1>
    Script by <Brian Ringley>
        def libraries() by <Giulio Piacentino> see <http://www.grasshopper3d.com/forum/topics/gh-filename-is-python>
        def writeToFile() by <Data Analytics Society> see <https://www.youtube.com/watch?v=-TF3mXhnCDw>
    Script version <15 September 2015> 
    Copyright <Creative Commons Sharealike>
"""


#add dsearch default path located on cad.local
import sys
new_path = r"\\sesthfs02\DSEARCH\REPOSITORY\Grasshopper\Xtras\DsearchCode"
if new_path not in sys.path: sys.path.append(new_path)

#import dsearch plugin
import dsearch as ds

import os

print sys.path

#reload module (this has use when working on module)
#reload(ds.DS_Log)
#reload(ds.DS_Links)

#setup template
template=ds.DS_Links.Template
ds.DS_Log.DS_Template(template)

#run help from module 
if Help:
    helpLink=ds.DS_Links.HelpLink
    ds.DS_Log.DS_Help(helpLink)

    #turn toggle back to false
    obj=ghenv.Component.Params.Input[0].Sources[0]
    obj.Value=False
    obj.ExpireSolution(True)
# ---------- end dss_log_v5_2 ----------

dss_projectnumber = Panel("0000")
# DSS_Author: Staffan Linné
# staffan.linne@white.se
# Function
# To be used in a sheet view
# Input:
# Selection (object selected in Revit) off a Line and several viewports and texts
# 
# Function:
# Places viewports along line. Texts moves with the closest viewport
dss_projectname = Panel("name")

# ----
# Organization of Grasshopper scripts at White:
# Script should be created and annotated always with notion that other person will need to use/edit them.
# Build your script in modules and segments, use color coding and annotation according this template.
# This standard should be applied to all scripts, big or small.
# 
# Read  guide on white work:
# "https://work.white.se/grasshopper-developer-guide/"
# For Advanced users:
# For design scripts running more than a month use "dsInitialize" and "dsScriptLog" functions on Dsearch tab to log changes over time.
dss_annotation_panel_2 = Panel("""Tip of a day:
You can change default colour grups by right clicking
Graphical templates are located on "Dsearch" tab""")
# GRAPHIC
# STANDARD
# In
# data and geometry import from rhino or external platforms
image = ImageSampler(dss_annotation_panel_2, Filter="Colour", Interpolate=False, Umax=1, Umin=0, Vmax=1, Vmin=0, Wrap=0)

active_selection = GraphicalElement()

query_categories = QueryCategories(Type=2, Name="Text Notes", IsVisibleUI=True, IsSubcategory=False)
catfltr = CategoryFilter(Categories=query_categories, Inverted=False)
filtelem = FilterElements(Elements=active_selection, Filter=catfltr)
cull = CullPattern(List=active_selection, CullPattern=filtelem)
graphical_element = GraphicalElement(cull)

view = View(active_selection)
# Sort objects
null = NullItem(Item=view)  # -> NullFlags, InvalidFlags, Description
cull_2 = CullPattern(List=view, CullPattern=invert(null.NullFlags))

# ---- group: Find frame of parent
query_categories_2 = QueryCategories(Type=1, Name="Lines", IsVisibleUI=True, IsSubcategory=False)
catfltr_2 = CategoryFilter(Categories=query_categories_2, Inverted=False)
query_elements = QueryElements(Filter=catfltr_2, Limit=10)  # -> Elements, Count
item = ListItem(List=query_elements.Elements, Index=0, Wrap=True)
inspect = InspectElement(Element=item)  # -> DimensionsLength, GraphicsLineStyle, GraphicsDetailLine, IdentityDataEditedBy, IdentityDataWorkset
parameter = Parameter(inspect.GraphicsLineStyle)
query_line_styles = QueryLineStyles(Name="Viewframe_Parent_RiR")
equals = EqualsRule(Parameter=parameter, Value=query_line_styles)
parafltr = ParameterFilter(Rules=equals, Inverted=False)
query_elements_2 = QueryElements(Filter=parafltr, Limit=100)  # -> Elements, Count
join = JoinCurves(Curves=query_elements_2.Elements, Preserve=False)

# ----
view_2 = View(cull_2)

# ----
# Control
# General
# Monitor
# Out
# variable parameters and script execution
# (sliders, boolean togggle, text input,...)
# monitor data and geometry preview (used for panels for example)
# output data to rhino or external platforms
# WIP
# Annotation
# Plugin
# general annotation and notes
# textbased scripting and special plugins
# f.ex: HumanUI, kangaroo,...
# problematic or under repair or construction
dss_annotation_panel_3 = Panel("general development modules")

element_workset = ElementWorkset(Element=query_elements_2.Elements)  # -> Element, Workset, Status
list_item = ListItem(List=element_workset.Workset, Index=0, Wrap=True)
panel = Panel("""Dimensions
Grids""")
list_length = ListLength(List=join)
equality = Equality(FirstNumber=list_length, SecondNumber="1")  # -> Equality, Inequality
stream_filter = StreamFilter(Gate=equality.Equality, Stream1=list_item)
text_split = TextSplit(Text=stream_filter, Separators="\"")

# ---- group: Hide studd that disturbs viewport border
# Hide stuff that disturbs viewport border
view_3 = View(view_2)
query_categories_3 = QueryCategories(Type=2, Name=panel, IsVisibleUI=True, IsSubcategory=False)  # -> flatten(Categories)
query_categories_4 = QueryCategories(Type=1, Name="Detail Items", IsVisibleUI=True, IsSubcategory=False)
query_view_elements = QueryViewElements(View=simplify(graft(view_3)), Categories=flatten([query_categories_4, query_categories_3]))  # -> simplify(Elements)
bool = Boolean(Toggle(True))
element_graphic_overrides = ElementGraphicOverrides(View=simplify(graft(view_3)), Element=query_view_elements, Hidden=bool)  # -> View, Element, flatten(Hidden), Overrides

# ----
list_item_2 = ListItem(List=text_split, Index="1", Wrap=True)
text_split_2 = TextSplit(Text=list_item_2, Separators=":")
list_item_3 = ListItem(List=text_split_2, Index="1", Wrap=True)

# ---- group: Find updated viewports
# Find updaed viewports
inspect_2 = InspectElement(Element=element_graphic_overrides.View)
cset = CreateSet(List=flatten(inspect_2))  # -> Set, Map
# Back-end
query_sheets = QuerySheets(Placeholder=False, SheetName=cset.Set, AppearsInSheetList=True, Assembly=null)
query_viewports = QueryViewports(Sheet=query_sheets)

# ----
list_item_4 = ListItem(List=flatten(element_graphic_overrides.View), Index=0, Wrap=True)
query_sheets_2 = QuerySheets(Placeholder=False, AppearsInSheetList=True, Assembly=null)
text_trim = TextTrim(Text=list_item_3, Start=True, End=True)

view_4 = View(list_item_4)
element_parameter = ElementParameter(Element=view_4, Parameter="Sheet Number")  # -> Element, Value
query_sheets_3 = QuerySheets(Placeholder=False, SheetNumber=element_parameter.Value, AppearsInSheetList=True, Assembly=null)
query_viewports_2 = QueryViewports(Sheet=query_sheets_3)  # -> simplify(Viewports)

match_text = MatchText(Text=query_sheets_2, RegEx=text_trim, Case=True)
cull_pattern = CullPattern(List=query_sheets_2, CullPattern=match_text)
query_viewports_3 = QueryViewports(Sheet=cull_pattern)
rectangle = Rectangle(join)
view_5 = View(query_viewports)
rectangle_2 = Rectangle(query_viewports_3)
area = Area(Geometry=rectangle)  # -> Area, Centroid
area_2 = Area(Geometry=rectangle_2)  # -> Area, Centroid
closest_point = ClosestPoint(Point=area.Centroid, Cloud=area_2.Centroid)  # -> ClosestPoint, CPIndex, Distance
list_item_5 = ListItem(List=query_viewports_3, Index=closest_point.CPIndex, Wrap=True)
member_index = MemberIndex(Set=flatten(query_viewports_2), Member=list_item_5)  # -> Index, Count
list_item_6 = ListItem(List=query_viewports_2, Index=member_index.Index, Wrap=True)
rectangle_3 = Rectangle(list_item_6)
debox = DeconstructBox(Box=rectangle_3)  # -> Plane, X, Y, Z
dedomain = DeconstructDomain(Domain=debox.Y)  # -> Start, End
subtraction = Subtraction(A=dedomain.End, B=dedomain.Start)
num = Number(subtraction)
bounding_rectangle = BoundingRectangle(Geometry=query_sheets_3, Plane=PlaneXY(0, 0, 0), Axis=0, Slide=0, Union=True)  # -> Bounding, DimensionX, DimensionY
area_3 = Area(Geometry=rectangle_3)  # -> Area, Centroid
division = Division(A=num, B=Slider(2, range=0..10))
unit_y = UnitY(Factor=division)
negative = Negative(Value=unit_y)
number_slider = Slider(7, range=0..10)
width_of_viewport_frame = Panel("3.05")
negative_2 = Negative()

line = Line(active_selection)
null_2 = NullItem(Item=line)  # -> NullFlags, InvalidFlags, Description
cull_3 = CullPattern(List=line, CullPattern=invert(null_2.NullFlags))

length = Length(Curve=cull_3)
sort_list = SortList(Keys=length, ValuesValuesA=cull_3)  # -> Keys, reverse(ValuesValuesA)

item_2 = ListItem(List=sort_list.ValuesValuesA, Index=0, Wrap=True)

line_2 = Line(item_2)

# ---- group: Setting direction of line
Y = UnitY(Factor=1)
# Sets direction of line so the way you
# draw the line doesnt matters.
vec = Vector(line_2)
pt = ConstructPoint(XCoordinate=0, YCoordinate=0, ZCoordinate=0)
pt_2 = ConstructPoint(XCoordinate=0, YCoordinate=0, ZCoordinate=0)
pt_3 = ConstructPoint(XCoordinate=Slider(1, range=0..1), YCoordinate=0, ZCoordinate=0)
pt_4 = ConstructPoint(XCoordinate=0, YCoordinate=Slider(1, range=0..1), ZCoordinate=0)
dprod = DotProduct(VectorA=unitize(vec), VectorB=unitize(Y), Unitize=False)
ln = Line(StartPoint=pt, EndPoint=pt_3)
ln_2 = Line(StartPoint=pt_4, EndPoint=pt_2)
abs = Absolute(Value=dprod)
flip = FlipCurve(Curve=line_2, Guide=ln_2)  # -> Curve, Flag
flip_2 = FlipCurve(Curve=line_2, Guide=ln)  # -> Curve, Flag
round = Round(Number=abs)  # -> Nearest, Floor, Ceiling
filter = StreamFilter(Gate=round.Nearest, Stream0=flip_2.Curve, Stream1=flip.Curve)
line_3 = Line(filter)

# ----
# Same sorting of views and viewports
view_6 = View(view_2)
element_name = ElementName(Element=view_5)  # -> Element, Name
element_name_2 = ElementName(Element=view_6)  # -> Element, Name

text = Text(element_name.Name)
text_2 = Text(element_name_2.Name)

mindex = MemberIndex(Set=text, Member=simplify(graft(text_2)))  # -> simplify(flatten(Index)), Count
item_3 = ListItem(List=query_viewports, Index=mindex.Index, Wrap=True)
rec = Rectangle(item_3)

# ---- group: Chooses point at viewport frame to orientate from
# Chooses point at viewport frame to orientate from
# can be changed
rec_2 = Rectangle(rec)
explode = Explode(Curve=rec_2, Recursive=True)  # -> Segments, Vertices
end = EndPoints(Curve=explode.Segments)  # -> simplify(Start), End
item_4 = ListItem(List=end.Start, Index=Slider(2, range=0..10), Wrap=True)

# ---- group: Sort viewports along curve
crv = Curve(line_3)
end_2 = EndPoints(Curve=crv)  # -> Start, End
dist = Distance(PointA=end_2.Start, PointB=item_4)  # -> flatten(Distance)
sort = SortList(Keys=dist, ValuesA=rec_2)  # -> Keys, ValuesA
sort_2 = SortList(Keys=dist, ValuesA=item_3)  # -> Keys, ValuesA

# ----
bounding_rectangle_2 = BoundingRectangle(Geometry=rec, Plane=PlaneXY(0, 0, 0), Axis=0, Slide=0, Union=True)  # -> Bounding, DimensionX, DimensionY
unit_y_2 = UnitY(Factor=bounding_rectangle_2.DimensionX)
unit_x = UnitX(Factor=bounding_rectangle_2.DimensionX)
line_sdl = LineSDL(Start=area_3.Centroid, Direction=unit_x, Length=bounding_rectangle.DimensionY)
move = Move(Geometry=line_sdl, Motion=negative)  # -> Geometry, Transform

# ----
# Height and width of viewport rectangle
rec_3 = Rectangle(sort.ValuesA)
debox_2 = DeconstructBox(Box=rec_3)  # -> Plane, X, Y, Z

# ---- group: Length
dedomain_2 = DeconstructDomain(Domain=debox_2.X)  # -> Start, End
subtraction_2 = Subtraction(A=dedomain_2.End, B=dedomain_2.Start)

# ---- group: Heigth
dedomain_3 = DeconstructDomain(Domain=debox_2.Y)  # -> Start, End
subtraction_3 = Subtraction(A=dedomain_3.End, B=dedomain_3.Start)

# ----
num_2 = Number(subtraction_3)
num_3 = Number(subtraction_2)

area_4 = Area(Geometry=rec_3)  # -> Area, Centroid
curve_closest_point = CurveClosestPoint(Point=area_4.Centroid, Curve=move.Geometry)  # -> Point, Parameter, Distance

# ---- group: Adjoust curve length
crv_2 = Curve(crv)
division_2 = Division(A=width_of_viewport_frame, B="2")
multiplication = Multiplication(A=width_of_viewport_frame, B="2")
neg = Negative(Value=division_2)
bool_2 = Boolean(round.Nearest)
filter_2 = StreamFilter(Gate=bool_2, Stream0=multiplication, Stream1=neg)
item_5 = ListItem(List=num_3, Index="-1", Wrap=True)
neg_2 = Negative(Value=filter_2)
addition = Addition(A=neg_2, B=item_5)
division_3 = Division(A=width_of_viewport_frame, B="2")
neg_3 = Negative(Value=addition)
lng = ListLength(List=sort.ValuesA)
subtraction_4 = Subtraction(A=lng, B=Slider(1, range=0..1))
ext = ExtendCurve(Curve=crv_2, Type=0, Start=division_3, End=neg_3)
divide = DivideCurve(Curve=ext, Count=subtraction_4, Kinks=False)  # -> Points, Tangents, Parameters

# ---- group: Create corner to center point vector
division_4 = Division(A=num_3, B=Slider(2, range=0..10))
division_5 = Division(A=num_2, B=Slider(2, range=0..10))
subtraction_5 = Subtraction(A=division_5, B=width_of_viewport_frame)
subtraction_6 = Subtraction(A=division_4, B=width_of_viewport_frame)
neg_4 = Negative(Value=subtraction_5)
vec_2 = VectorXYZ(XComponent=subtraction_6, YComponent=subtraction_5, ZComponent=0)  # -> Vector, Length
move_2 = Move(Geometry=divide.Points, Motion=vec_2.Vector)  # -> Geometry, Transform

# ----
subtraction_7 = Subtraction(A=division_5, B=number_slider)
addition_2 = Addition(A=division_5, B=number_slider)
unit_y_3 = UnitY(Factor=addition_2)
move_3 = Move(Geometry=curve_closest_point.Point, Motion=unit_y_3)  # -> Geometry, Transform
length_2 = Length(Curve=crv_2)

# ---- group: Move texts in selection
rec_4 = Rectangle(rec_3)
pcen = PolygonCenter(Polyline=rec_4)  # -> CenterV, CenterE, CenterA
graphical_element_2 = GraphicalElement(graphical_element)
vec2pt = Vector2Pt(PointA=pcen.CenterV, PointB=move_2.Geometry, Unitize=False)  # -> Vector, Length
brec = BoundingRectangle(Geometry=graphical_element_2, Plane=PlaneXY(0, 0, 0), Axis=0, Slide=0, Union=False)  # -> Bounding, DimensionX, DimensionY
pcen_2 = PolygonCenter(Polyline=brec.Bounding)  # -> CenterV, CenterE, CenterA
lng_2 = ListLength(List=rec_4)
crv_cp = CurveClosestPoint(Point=simplify(graft(pcen_2.CenterV)), Curve=rec_4)  # -> simplify(Point), Parameter, simplify(Distance)
series = Series(Start=0, Step=1, Count=lng_2)
sort_3 = SortList(Keys=crv_cp.Distance, ValuesA=series)  # -> Keys, simplify(ValuesA)
item_6 = ListItem(List=sort_3.ValuesA, Index=0, Wrap=True)
item_7 = ListItem(List=vec2pt.Vector, Index=item_6, Wrap=True)  # -> flatten(Item)
element_location = ElementLocation(Element=graphical_element_2)  # -> Element, Location, Hand, Facing, WorkPlane
move_4 = Move(Geometry=element_location.Location, Motion=item_7)  # -> Geometry, Transform
element_location_2 = ElementLocation(Element=element_location.Element, Location=move_4.Geometry)  # -> Element, Location, Hand, Facing, WorkPlane

# ---- group: Place viewports at new point
element_location_3 = ElementLocation(Element=sort_2.ValuesA, Location=move_3.Geometry)  # -> Element, Location, Hand, Facing, WorkPlane
pt_5 = Point(element_location_3.Location)
bool_3 = Boolean(invert(bool))
graphical_element_3 = GraphicalElement(query_view_elements)
view_7 = View(element_location_3.Element)
element_graphic_overrides_2 = ElementGraphicOverrides(View=simplify(graft(view_7)), Element=graphical_element_3, Hidden=bool_3)  # -> View, Element, flatten(Hidden), Overrides
