# Grasshopper definition 01_VP_Align_Set.gh (Grasshopper 1.0.8)
# plug-ins: Rhino.Inside for Autodesk Revit, MetaHopper

doubleclick = BooleanToggle(False)
dss_annotation_panel = Panel("Help on WhiteWork")
# Segment
# group modules into larger coherent parts
# User Interface: I/O
dss_log_v5_2 = PythonScript(Help=doubleclick)  # inputs Help: Boolean
# ---------- dss_log_v5_2: Python ----------
"""
Set grasshopper template and provide easy acces to Help file in intranet

"""

"""
Credits:
    20211117
    Created by Vladimir Ondejcik
    White arkitekter AB

Based on:
    WOMBAT version <0.0.1>
    Script by <Brian Ringley>
        def libraries() by <Giulio Piacentino> see <http://www.grasshopper3d.com/forum/topics/gh-filename-is-python>
        def writeToFile() by <Data Analytics Society> see <https://www.youtube.com/watch?v=-TF3mXhnCDw>
    Script version <15 September 2015> 
    Copyright <Creative Commons Sharealike>
"""


#add dsearch default path located on cad.local
import sys
new_path = r"\\sesthfs02\DSEARCH\REPOSITORY\Grasshopper\Xtras\DsearchCode"
if new_path not in sys.path: sys.path.append(new_path)

#import dsearch plugin
import dsearch as ds

import os

print sys.path

#reload module (this has use when working on module)
#reload(ds.DS_Log)
#reload(ds.DS_Links)

#setup template
template=ds.DS_Links.Template
ds.DS_Log.DS_Template(template)

#run help from module 
if Help:
    helpLink=ds.DS_Links.HelpLink
    ds.DS_Log.DS_Help(helpLink)

    #turn toggle back to false
    obj=ghenv.Component.Params.Input[0].Sources[0]
    obj.Value=False
    obj.ExpireSolution(True)
# ---------- end dss_log_v5_2 ----------

dss_projectnumber = Panel("0000")
dss_projectname = Panel("name")

# ----
# Organization of Grasshopper scripts at White:
# Script should be created and annotated always with notion that other person will need to use/edit them.
# Build your script in modules and segments, use color coding and annotation according this template.
# This standard should be applied to all scripts, big or small.
# 
# Read  guide on white work:
# "https://work.white.se/grasshopper-developer-guide/"
# For Advanced users:
# For design scripts running more than a month use "dsInitialize" and "dsScriptLog" functions on Dsearch tab to log changes over time.
dss_annotation_panel_2 = Panel("""Tip of a day:
You can change default colour grups by right clicking
Graphical templates are located on "Dsearch" tab""")
# GRAPHIC
# STANDARD
# In
# data and geometry import from rhino or external platforms
image = ImageSampler(dss_annotation_panel_2, Filter="Colour", Interpolate=False, Umax=1, Umin=0, Vmax=1, Vmin=0, Wrap=0)

active_selection = GraphicalElement()
query_categories = QueryCategories(Type=2, Name="Viewports", IsVisibleUI=True, IsSubcategory=False)

# ---- group: Find frame of parent
query_categories_2 = QueryCategories(Type=1, Name="Lines", IsVisibleUI=True, IsSubcategory=False)
catfltr = CategoryFilter(Categories=query_categories_2, Inverted=False)
query_elements = QueryElements(Filter=catfltr, Limit=10)  # -> Elements, Count
item = ListItem(List=query_elements.Elements, Index=0, Wrap=True)
inspect = InspectElement(Element=item)  # -> DimensionsLength, GraphicsLineStyle, GraphicsDetailLine, IdentityDataEditedBy, IdentityDataWorkset
parameter = Parameter(inspect.GraphicsLineStyle)
query_line_styles = QueryLineStyles(Name="Viewframe_Parent_RiR")
equals = EqualsRule(Parameter=parameter, Value=query_line_styles)
parafltr = ParameterFilter(Rules=equals, Inverted=False)
query_elements_2 = QueryElements(Filter=parafltr, Limit=100)  # -> Elements, Count
join = JoinCurves(Curves=query_elements_2.Elements, Preserve=False)

# ---- group: RUN SCRIPT
onoff = EnableDisableObject(Enabled=Button())

# ---- group: RUN SCRIPT / Predictible viewport
bool = Boolean(Toggle(True))

# ----
catfltr_2 = CategoryFilter(Categories=query_categories, Inverted=False)
onoff_2 = EnableDisableObject(Enabled=bool, AllObjects_Object=element_graphic_overrides)
panel = Panel("""Sections
Elevations""")

# ----
# Control
# General
# Monitor
# Out
# variable parameters and script execution
# (sliders, boolean togggle, text input,...)
# monitor data and geometry preview (used for panels for example)
# output data to rhino or external platforms
# Annotation
# Plugin
# general annotation and notes
# textbased scripting and special plugins
# f.ex: HumanUI, kangaroo,...
# problematic or under repair or construction
dss_annotation_panel_3 = Panel("general development modules")

query_categories_3 = QueryCategories(Type=2, Name=panel, IsVisibleUI=True, IsSubcategory=False)  # -> flatten(Categories)
panel_2 = Panel("""Detail Items
Lines
Text Notes""")
panel_3 = Panel("""Dimensions
Grids
Sections
Levels
Text Notes
Spot Elevations""")
panel_4 = Panel("Tag")
query_categories_4 = QueryCategories(Discipline=1, Type=2, IsVisibleUI=True, IsSubcategory=False)  # -> flatten(Categories)
match_text = MatchText(Text=query_categories_4, RegEx="Tags", Case=True)
element_workset = ElementWorkset(Element=query_elements_2.Elements)  # -> Element, Workset, Status
query_categories_5 = QueryCategories(Type=1, IsVisibleUI=True, IsSubcategory=False)
cull_pattern = CullPattern(List=query_categories_4, CullPattern=match_text)
list_item = ListItem(List=element_workset.Workset, Index=0, Wrap=True)
list_length = ListLength(List=join)
query_view_types = QueryViewTypes()
equality = Equality(FirstNumber=list_length, SecondNumber="1")  # -> Equality, Inequality
stream_filter = StreamFilter(Gate=equality.Equality, Stream1=active_selection)
view = View(stream_filter)
sheet = Sheet(stream_filter)
filtelem = FilterElements(Elements=stream_filter, Filter=catfltr_2)
panel_5 = Panel([view, sheet])
cull = CullPattern(List=stream_filter, CullPattern=filtelem)
element_type = ElementType(Element=cull)  # -> Element, Type
element_parameter = ElementParameter(Element=element_type.Type, Parameter="Show Title")  # -> Element, Value
element_parameter_2 = ElementParameter(Element=element_parameter.Element, Parameter="Show Title", Value=Toggle(False))  # -> Element, Value
stream_filter_2 = StreamFilter(Gate=element_parameter_2.Value, Stream0=cull)

# ---- group: Hide studd that disturbs viewport border
# Hide stuff that disturbs viewport border
panel_6 = Panel("Views")
view_2 = View(stream_filter_2)
query_categories_6 = QueryCategories(Type=1, Name=flatten(panel_2), IsVisibleUI=True, IsSubcategory=False)
query_categories_7 = QueryCategories(Type=4, Name=panel_6, IsVisibleUI=True, IsSubcategory=False)
query_categories_8 = QueryCategories(Type=2, Name=panel_3, IsVisibleUI=True, IsSubcategory=False)  # -> flatten(Categories)
query_view_elements = QueryViewElements(
    View=simplify(graft(view_2)),
    Categories=flatten([query_categories_6, query_categories_8, query_categories_3, query_categories_7, cull_pattern]))  # -> simplify(Elements)
# Back-end
element_graphic_overrides = ElementGraphicOverrides(View=simplify(graft(view_2)), Element=query_view_elements, Hidden=bool)  # -> View, Element, flatten(Hidden), Overrides

# ----
stream_filter_3 = StreamFilter(Gate=equality.Equality, Stream1=list_item)
view_3 = View(element_graphic_overrides.View)
text_split = TextSplit(Text=stream_filter_3, Separators="\"")
view_crop_region = ViewCropRegion(View=view_3)  # -> View, CropView, CropRegionVisible, CropRegion
view_identity = ViewIdentity(View=view_2)  # -> Discipline, ViewFamily, ViewName, IsDependent, IsTemplate, IsAssembly, IsPrintable
list_item_2 = ListItem(List=text_split, Index="1", Wrap=True)
text_split_2 = TextSplit(Text=list_item_2, Separators=":")
plane = Plane(view_crop_region.View)
view_crop_region_2 = ViewCropRegion(View=view_crop_region.View, CropView=Toggle(True))  # -> View, CropView, CropRegionVisible, CropRegion
list_item_3 = ListItem(List=text_split_2, Index="1", Wrap=True)
query_sheets = QuerySheets(Placeholder=False, AppearsInSheetList=True, Assembly=null)
text_trim = TextTrim(Text=list_item_3, Start=True, End=True)
rectangle = Rectangle(view_crop_region_2.CropRegion)
match_text_2 = MatchText(Text=query_sheets, RegEx=text_trim, Case=True)
cull_pattern_2 = CullPattern(List=query_sheets, CullPattern=match_text_2)
query_viewports = QueryViewports(Sheet=cull_pattern_2)
rectangle_2 = Rectangle(join)
rectangle_3 = Rectangle(query_viewports)
area = Area(Geometry=rectangle_2)  # -> Area, Centroid
area_2 = Area(Geometry=rectangle_3)  # -> Area, Centroid
closest_point = ClosestPoint(Point=area.Centroid, Cloud=area_2.Centroid)  # -> ClosestPoint, CPIndex, Distance
rectangle_4 = Rectangle(join)
area_3 = Area(Geometry=rectangle_4)  # -> Area, Centroid
pcen = PolygonCenter(Polyline=rectangle_4)  # -> CenterV, CenterE, CenterA
list_item_4 = ListItem(List=query_viewports, Index=closest_point.CPIndex, Wrap=True)
element_location = ElementLocation(Element=stream_filter)  # -> Element, Location, Hand, Facing, WorkPlane
view_4 = View(list_item_4)
view_crop_region_3 = ViewCropRegion(View=view_4)  # -> View, CropView, CropRegionVisible, CropRegion
plane_2 = Plane(view_crop_region_3.View)
rectangle_5 = Rectangle(view_crop_region_3.CropRegion)
orient = Orient(Geometry=rectangle_5, Source=plane_2, Target=plane)  # -> Geometry, Transform
view_crop_region_4 = ViewCropRegion(View=view_crop_region_2.View, CropRegion=rectangle_5)  # -> View, CropView, CropRegionVisible, CropRegion
view_5 = View(view_crop_region_4.View)

view_6 = View(view_5)
# WIP
# Fungerar inte för sektioner/fasader etc.
# Behöver rotationsdel
panel_7 = Panel("Title on Sheet")
element_parameter_3 = ElementParameter(Element=view_6, Parameter="Sheet Number")  # -> Element, Value
query_sheets_2 = QuerySheets(Placeholder=False, SheetNumber=element_parameter_3.Value, AppearsInSheetList=True, Assembly=null)
element_parameter_4 = ElementParameter(Element=view_6, Parameter=panel_7)  # -> Element, Value
query_viewports_2 = QueryViewports(Sheet=query_sheets_2)
match_text_3 = MatchText(Text=query_viewports_2, RegEx=element_parameter_4.Value, Case=True)
cull_pattern_3 = CullPattern(List=query_viewports_2, CullPattern=match_text_3)

query_viewports_3 = QueryViewports(Sheet=cull_pattern_3)
member_index = MemberIndex(Set=query_viewports_3, Member=cull)  # -> Index, Count
list_item_5 = ListItem(List=query_viewports_3, Index=member_index.Index, Wrap=True)
rectangle_6 = Rectangle(list_item_5)
pcen_2 = PolygonCenter(Polyline=rectangle_6)  # -> CenterV, CenterE, CenterA
area_4 = Area(Geometry=rectangle_6)  # -> Area, Centroid
vec2pt = Vector2Pt(PointA=area_4.Centroid, PointB=area_3.Centroid, Unitize=False)  # -> Vector, Length
vdis = VectorDisplay(Anchor=pcen_2.CenterV, Vector=vec2pt.Vector)
move = Move(Geometry=element_location.Location, Motion=vec2pt.Vector)  # -> Geometry, Transform
element_location_2 = ElementLocation(Element=element_location.Element, Location=move.Geometry)  # -> Element, Location, Hand, Facing, WorkPlane
view_7 = View(element_location_2.Element)

element_graphic_overrides_2 = ElementGraphicOverrides(View=simplify(graft(view_7)), Element=query_view_elements, Hidden=Toggle(False))  # -> View, Element, flatten(Hidden), Overrides
view_crop_region_5 = ViewCropRegion(View=element_graphic_overrides_2.View, CropView=view_crop_region.CropView, CropRegion=rectangle)  # -> View, CropView, CropRegionVisible, CropRegion

# ---- group: Reset view title
view_8 = View(element_graphic_overrides_2.View)

# ----
view_9 = View(view_8)
element_parameter_5 = ElementParameter(Element=view_9, Parameter="Sheet Number")  # -> Element, Value
query_sheets_3 = QuerySheets(Placeholder=False, SheetNumber=element_parameter_5.Value, AppearsInSheetList=True, Assembly=null)
element_parameter_6 = ElementParameter(Element=view_9, Parameter="Title on Sheet")  # -> Element, Value
query_viewports_4 = QueryViewports(Sheet=query_sheets_3)
match_text_4 = MatchText(Text=query_viewports_4, RegEx=element_parameter_6.Value, Case=True)
cull_pattern_4 = CullPattern(List=query_viewports_4, CullPattern=match_text_4)

# ---- group: Reset view title (continued)
sheet_2 = Sheet(cull_pattern_4)
query_viewports_5 = QueryViewports(Sheet=sheet_2)
member_index_2 = MemberIndex(Set=query_viewports_5, Member=cull)  # -> Index, Count
list_item_6 = ListItem(List=query_viewports_5, Index=member_index_2.Index, Wrap=True)
element_type_2 = ElementType(Element=list_item_6)  # -> Element, Type
element_parameter_7 = ElementParameter(Element=element_type_2.Type, Parameter="Show Title", Value=element_parameter.Value)  # -> Element, Value
