# Grasshopper definition 11_VP_Align_L.gh (Grasshopper 1.0.8)
# plug-ins: Pufferfish, Rhino.Inside for Autodesk Revit

doubleclick = BooleanToggle(False)
dss_annotation_panel = Panel("Help on WhiteWork")
# Segment
# group modules into larger coherent parts
# User Interface: I/O
dss_log_v5_2 = PythonScript(Help=doubleclick)  # inputs Help: Boolean
# ---------- dss_log_v5_2: Python ----------
"""
Set grasshopper template and provide easy acces to Help file in intranet

"""

"""
Credits:
    20211117
    Created by Vladimir Ondejcik
    White arkitekter AB

Based on:
    WOMBAT version <0.0.1>
    Script by <Brian Ringley>
        def libraries() by <Giulio Piacentino> see <http://www.grasshopper3d.com/forum/topics/gh-filename-is-python>
        def writeToFile() by <Data Analytics Society> see <https://www.youtube.com/watch?v=-TF3mXhnCDw>
    Script version <15 September 2015> 
    Copyright <Creative Commons Sharealike>
"""


#add dsearch default path located on cad.local
import sys
new_path = r"\\sesthfs02\DSEARCH\REPOSITORY\Grasshopper\Xtras\DsearchCode"
if new_path not in sys.path: sys.path.append(new_path)

#import dsearch plugin
import dsearch as ds

import os

print sys.path

#reload module (this has use when working on module)
#reload(ds.DS_Log)
#reload(ds.DS_Links)

#setup template
template=ds.DS_Links.Template
ds.DS_Log.DS_Template(template)

#run help from module 
if Help:
    helpLink=ds.DS_Links.HelpLink
    ds.DS_Log.DS_Help(helpLink)

    #turn toggle back to false
    obj=ghenv.Component.Params.Input[0].Sources[0]
    obj.Value=False
    obj.ExpireSolution(True)
# ---------- end dss_log_v5_2 ----------

dss_projectnumber = Panel("0000")
# DSS_Author: Staffan Linné
# staffan.linne@white.se
# Function
# To be used in a sheet view
# Input:
# Selection (object selected in Revit) off a Line and several viewports and texts
# 
# Function:
# Places viewports along line. Texts moves with the closest viewport
dss_projectname = Panel("name")

# ----
# Organization of Grasshopper scripts at White:
# Script should be created and annotated always with notion that other person will need to use/edit them.
# Build your script in modules and segments, use color coding and annotation according this template.
# This standard should be applied to all scripts, big or small.
# 
# Read  guide on white work:
# "https://work.white.se/grasshopper-developer-guide/"
# For Advanced users:
# For design scripts running more than a month use "dsInitialize" and "dsScriptLog" functions on Dsearch tab to log changes over time.
dss_annotation_panel_2 = Panel("""Tip of a day:
You can change default colour grups by right clicking
Graphical templates are located on "Dsearch" tab""")
# GRAPHIC
# STANDARD
# In
# data and geometry import from rhino or external platforms
image = ImageSampler(dss_annotation_panel_2, Filter="Colour", Interpolate=False, Umax=1, Umin=0, Vmax=1, Vmin=0, Wrap=0)

active_selection = GraphicalElement()
# Sort objects
query_categories = QueryCategories(Type=2, Name="Viewports", IsVisibleUI=True, IsSubcategory=False)

# ---- group: Find frame of parent
query_categories_2 = QueryCategories(Type=1, Name="Lines", IsVisibleUI=True, IsSubcategory=False)
catfltr = CategoryFilter(Categories=query_categories_2, Inverted=False)
query_elements = QueryElements(Filter=catfltr, Limit=10)  # -> Elements, Count
item = ListItem(List=query_elements.Elements, Index=0, Wrap=True)
inspect = InspectElement(Element=item)  # -> DimensionsLength, GraphicsLineStyle, GraphicsDetailLine, IdentityDataEditedBy, IdentityDataWorkset
parameter = Parameter(inspect.GraphicsLineStyle)
query_line_styles = QueryLineStyles(Name="Viewframe_Parent_RiR")
equals = EqualsRule(Parameter=parameter, Value=query_line_styles)
parafltr = ParameterFilter(Rules=equals, Inverted=False)
query_elements_2 = QueryElements(Filter=parafltr, Limit=100)  # -> Elements, Count
join = JoinCurves(Curves=query_elements_2.Elements, Preserve=False)

# ----
catfltr_2 = CategoryFilter(Categories=query_categories, Inverted=False)
filtelem = FilterElements(Elements=active_selection, Filter=catfltr_2)
cull = CullPattern(List=active_selection, CullPattern=filtelem)

query_categories_3 = QueryCategories(Type=2, Name="Text Notes", IsVisibleUI=True, IsSubcategory=False)
catfltr_3 = CategoryFilter(Categories=query_categories_3, Inverted=False)
filtelem_2 = FilterElements(Elements=cull, Filter=catfltr_3)
cull_2 = CullPattern(List=cull, CullPattern=filtelem_2)
graphical_element = GraphicalElement(cull_2)

element_type = ElementType(Element=cull)  # -> Element, Type
create_set = CreateSet(List=element_type.Type)  # -> Set, Map
element_parameter = ElementParameter(Element=create_set.Set, Parameter="Show Title")  # -> Element, Value
# Sets direction of line so the way you
# draw the line doesnt matters.
view = View(cull)
element_parameter_2 = ElementParameter(Element=element_parameter.Element, Parameter="Show Title", Value=Toggle(False))  # -> Element, Value

# ----
# Control
# General
# Monitor
# Out
# variable parameters and script execution
# (sliders, boolean togggle, text input,...)
# monitor data and geometry preview (used for panels for example)
# output data to rhino or external platforms
# WIP
# Annotation
# Plugin
# general annotation and notes
# textbased scripting and special plugins
# f.ex: HumanUI, kangaroo,...
# problematic or under repair or construction
dss_annotation_panel_3 = Panel("general development modules")

# ---- group: Hide studd that disturbs viewport border
# Hide stuff that disturbs viewport border
panel = Panel("""Sections
Elevations""")
panel_2 = Panel("""Detail Items
Lines
Doors""")
query_categories_4 = QueryCategories(Discipline=1, Type=2, IsVisibleUI=True, IsSubcategory=False)  # -> flatten(Categories)
panel_3 = Panel("""Dimensions
Grids
Sections
Levels
Text Notes
Spot Elevations""")
query_categories_5 = QueryCategories(Type=2, Name=panel, IsVisibleUI=True, IsSubcategory=False)  # -> flatten(Categories)
match_text = MatchText(Text=query_categories_4, RegEx="Tags", Case=True)
view_2 = View(view)
query_categories_6 = QueryCategories(Type=1, Name=flatten(panel_2), IsVisibleUI=True, IsSubcategory=False)  # -> flatten(Categories)
query_categories_7 = QueryCategories(Type=4, Name="Views", IsVisibleUI=True, IsSubcategory=False)
query_categories_8 = QueryCategories(Type=2, Name=panel_3, IsVisibleUI=True, IsSubcategory=False)  # -> flatten(Categories)
cull_pattern = CullPattern(List=query_categories_4, CullPattern=match_text)
query_view_elements = QueryViewElements(
    View=simplify(graft(view_2)),
    Categories=flatten([query_categories_6, query_categories_8, query_categories_5, query_categories_7, cull_pattern]))  # -> simplify(Elements)
element_graphic_overrides = ElementGraphicOverrides(View=simplify(graft(view_2)), Element=query_view_elements)  # -> View, simplify(Element), flatten(Hidden), Overrides

# ----
bool = Boolean(Toggle(True))
element_graphic_overrides_2 = ElementGraphicOverrides(View=simplify(graft(view_2)), Element=element_graphic_overrides.Element, Hidden=bool)  # -> View, Element, flatten(Hidden), Overrides
# Back-end
# Find updaed viewports
list_item = ListItem(List=flatten(element_graphic_overrides_2.View), Index=0, Wrap=True)

# ----
# Same sorting of views and viewports
view_3 = View(list_item)
element_parameter_3 = ElementParameter(Element=view_3, Parameter="Sheet Number")  # -> Element, Value
query_sheets = QuerySheets(Placeholder=False, SheetNumber=element_parameter_3.Value, AppearsInSheetList=True, Assembly=null)
query_viewports = QueryViewports(Sheet=query_sheets)  # -> simplify(Viewports)

member_index = MemberIndex(Set=flatten(query_viewports), Member=cull)  # -> Index, Count
list_item_2 = ListItem(List=query_viewports, Index=flatten(member_index.Index), Wrap=True)
rectangle = Rectangle(list_item_2)
element_location = ElementLocation(Element=list_item_2)  # -> Element, Location, Hand, Facing, WorkPlane
point = Point(element_location.Location)
number_slider = Slider(100000, range=0..100000)
unit_z = UnitZ(Factor=1)
area = Area(Geometry=join)  # -> Area, Centroid
boolean = Boolean(element_parameter.Value)

width_of_viewport_frame = Panel("3.1")
explode = Explode(Curve=join, Recursive=True)  # -> Segments, Vertices
unit_y = UnitY(Factor=width_of_viewport_frame)
list_item_3 = ListItem(List=explode.Segments, Index="0", Wrap=True)
negative = Negative(Value=unit_y)

unit_x = UnitX(Factor=width_of_viewport_frame)
negative_2 = Negative(Value=unit_x)

move = Move(Geometry=list_item_3, Motion=negative_2)  # -> Geometry, Transform

extend_curve = ExtendCurve(Curve=move.Geometry, Type=0, Start=number_slider, End=number_slider)
vector = Vector(move.Geometry)
cross_product = CrossProduct(VectorA=vector, VectorB=unit_z, Unitize=True)  # -> Vector, Length
negative_3 = Negative(Value=cross_product.Vector)
curve_closest_point = CurveClosestPoint(Point=point, Curve=extend_curve)  # -> Point, Parameter, Distance
vector_2pt = Vector2Pt(PointA=point, PointB=curve_closest_point.Point, Unitize=False)  # -> Vector, Length

# ----
# Height and width of viewport rectangle
rec = Rectangle(rectangle)
debox = DeconstructBox(Box=rec)  # -> Plane, X, Y, Z

# ---- group: Heigth
dedomain = DeconstructDomain(Domain=debox.Y)  # -> Start, End
subtraction = Subtraction(A=dedomain.End, B=dedomain.Start)

# ---- group: Length
dedomain_2 = DeconstructDomain(Domain=debox.X)  # -> Start, End
subtraction_2 = Subtraction(A=dedomain_2.End, B=dedomain_2.Start)

# ----
num = Number(subtraction_2)
num_2 = Number(subtraction)

area_2 = Area(Geometry=rec)  # -> Area, Centroid
division = Division(A=flatten(num), B="2")
multiplication = Multiplication(A=division, B=negative_3)
move_2 = Move(Geometry=rec, Motion=vector_2pt.Vector)  # -> Geometry, Transform
move_3 = Move(Geometry=curve_closest_point.Point, Motion=multiplication)  # -> Geometry, Transform
move_4 = Move(Geometry=move_2.Geometry, Motion=multiplication)  # -> Geometry, Transform
distance = Distance(PointA=move_3.Geometry, PointB=area.Centroid)

# ---- group: Move texts in selection
rec_2 = Rectangle(rec)  # disabled
pcen = PolygonCenter(Polyline=rec_2)  # -> CenterV, CenterE, CenterA; disabled
graphical_element_2 = GraphicalElement(graphical_element)  # disabled
vec2pt = Vector2Pt(PointA=pcen.CenterV, Unitize=False)  # -> Vector, Length; disabled
brec = BoundingRectangle(Geometry=graphical_element_2, Plane=PlaneXY(0, 0, 0), Axis=0, Slide=0, Union=False)  # -> Bounding, DimensionX, DimensionY; disabled
pcen_2 = PolygonCenter(Polyline=brec.Bounding)  # -> CenterV, CenterE, CenterA; disabled
lng = ListLength(List=rec_2)  # disabled
crv_cp = CurveClosestPoint(Point=simplify(graft(pcen_2.CenterV)), Curve=rec_2)  # -> simplify(Point), Parameter, simplify(Distance); disabled
series = Series(Start=0, Step=1, Count=lng)  # disabled
sort = SortList(Keys=crv_cp.Distance, ValuesA=series)  # -> Keys, simplify(ValuesA); disabled
item_2 = ListItem(List=sort.ValuesA, Index=0, Wrap=True)  # disabled
item_3 = ListItem(List=vec2pt.Vector, Index=item_2, Wrap=True)  # -> flatten(Item); disabled
element_location_2 = ElementLocation(Element=graphical_element_2)  # -> Element, Location, Hand, Facing, WorkPlane; disabled
move_5 = Move(Geometry=element_location_2.Location, Motion=item_3)  # -> Geometry, Transform; disabled
element_location_3 = ElementLocation(Element=element_location_2.Element, Location=move_5.Geometry)  # -> Element, Location, Hand, Facing, WorkPlane; disabled

# ---- group: Place viewports at new point
element_location_4 = ElementLocation(Element=cull, Location=move_3.Geometry)  # -> Element, Location, Hand, Facing, WorkPlane
pt = Point(element_location_4.Location)
view_4 = View(element_location_4.Element)
graphical_element_3 = GraphicalElement(element_graphic_overrides_2.Element)
bool_2 = Boolean(invert(bool))

# ----
element_graphic_overrides_3 = ElementGraphicOverrides(View=simplify(graft(view_4)), Element=element_graphic_overrides_2.Element, Hidden=bool_2)  # -> View, Element, flatten(Hidden), Overrides
view_5 = View(element_graphic_overrides_3.View)
element_parameter_4 = ElementParameter(Element=view_5, Parameter="Sheet Number")  # -> Element, Value
query_sheets_2 = QuerySheets(Placeholder=False, SheetNumber=element_parameter_4.Value, AppearsInSheetList=True, Assembly=null)  # -> flatten(Sheets)
create_set_2 = CreateSet(List=query_sheets_2)  # -> Set, Map

# ---- group: Reset view title
sheet = Sheet(create_set_2.Set)
query_viewports_2 = QueryViewports(Sheet=sheet)
member_index_2 = MemberIndex(Set=query_viewports_2, Member=cull)  # -> Index, Count
list_item_4 = ListItem(List=query_viewports_2, Index=member_index_2.Index, Wrap=True)
element_type_2 = ElementType(Element=list_item_4)  # -> Element, flatten(Type)

# ----
create_set_3 = CreateSet(List=element_type_2.Type)  # -> Set, Map

# ---- group: Reset view title (continued)
element_parameter_5 = ElementParameter(Element=create_set_3.Set, Parameter="Show Title", Value=boolean)  # -> Element, Value
